# Grasshopper definition 413_pick_and_place.ghx (Grasshopper 1.0.7)

# ----
# Home
number_slider = Slider(1.57, range=-3.14..3.14)
home_config = GhPythonScript(j=[number_slider, Slider(-1.57, range=-3.14..3.14), Slider(1.57, range=-3.14..3.14), Slider(-1.57, range=-3.14..3.14), Slider(-1.57, range=-3.14..3.14), Slider(3.14, range=-3.14..3.14)])  # -> config; inputs j: list
# ---------- home_config: Python ----------
from compas.robots import Configuration

config = Configuration.from_revolute_values(j)
# ---------- end home_config ----------

# ----
# Approach offset
approach_offset = Slider(0.05, range=0..0.2)

# ----
# Element
number_slider_2 = Slider(0.012, range=0.01..0.05)
python = GhPythonScript(h=number_slider_2, w=Slider(0.031, range=0.01..0.05), d=Slider(0.016, range=0.01..0.05))  # -> brick, mesh
# ---------- python: Python ----------
from compas.geometry import Box
from compas.datastructures import Mesh
from compas_ghpython.artists import MeshArtist

brick = Box.from_width_height_depth(w, h, d)
brick = Mesh.from_shape(brick)

mesh = MeshArtist(brick).draw()
# ---------- end python ----------

# ----
# INPUT
# ROS
connect = BooleanToggle(False)
load_robot = BooleanToggle(False)
ros = ROSConnect(connect=connect)  # -> ros_client, is_connected; inputs port: Int32, connect: Boolean
#   port ip: The ip address ROS. Defaults to 127.0.0.1.
#   port port: The port of ROS. Defaults to 9090.
#   port connect: If True, connects to ROS. If False, disconnects from ROS. Defaults to False.
#   port ros_client: The ROS client.
#   port is_connected: True if connection established.
# ---------- ros: Python ----------
"""
Connect or disconnect to ROS.

COMPAS FAB v0.19.1
"""
from ghpythonlib.componentbase import executingcomponent as component
from scriptcontext import sticky as st

from compas_fab.backends import RosClient
from compas_fab.ghpython.components import create_id


class ROSConnect(component):
    def RunScript(self, ip, port, connect):
        ros_client = None

        ip = ip or '127.0.0.1'
        port = port or 9090

        key = create_id(self, 'ros_client')
        ros_client = st.get(key, None)

        if ros_client:
            st[key].close()
        if connect:
            st[key] = RosClient(ip, port)
            st[key].run(5)

        ros_client = st.get(key, None)
        is_connected = ros_client.is_connected if ros_client else False
        return (ros_client, is_connected)
# ---------- end ros ----------
robot = ROSRobot(ros_client=ros.ros_client, load=load_robot)  # -> robot; inputs load: Boolean
#   port ros_client: The ROS client.
#   port load: If True, loads the robot from ROS. Defaults to False.
# ---------- robot: Python ----------
"""
Load robot directly from ROS.

COMPAS FAB v0.19.1
"""
from compas_ghpython.artists import RobotModelArtist
from ghpythonlib.componentbase import executingcomponent as component
from scriptcontext import sticky as st

from compas_fab.ghpython.components import create_id


class ROSRobot(component):
    def RunScript(self, ros_client, load):
        key = create_id(self, 'robot')

        if ros_client and ros_client.is_connected and load:
            # Load URDF from ROS
            st[key] = ros_client.load_robot(load_geometry=True, precision='12f')
            st[key].artist = RobotModelArtist(st[key].model)

        robot = st.get(key, None)
        if robot:  # client sometimes need to be restarted, without needing to reload geometry
            robot.client = ros_client
        return robot
# ---------- end robot ----------

# ----
# Tool
attach = BooleanToggle(False)
z_offset = Slider(0.07, range=-0.1..0.2)
attach_tool = GhPythonScript(robot=robot, attached=attach, z_offset=z_offset)  # -> tool_at_origin
# ---------- attach_tool: Python ----------
import os
from compas.geometry import Frame
from compas.datastructures import Mesh
from compas_fab.robots import PlanningScene
from compas_fab.robots import Tool
from compas_ghpython.artists import MeshArtist

HERE = os.path.dirname(ghenv.Component.OnPingDocument().FilePath)

# create tool from mesh and frame
mesh = Mesh.from_stl(os.path.join(HERE, 'vacuum_gripper.stl'))
frame = Frame([z_offset, 0, 0], [0, 0, 1], [0, 1, 0])
tool = Tool(mesh, frame, name='vacuum_gripper')
tool_at_origin = MeshArtist(mesh).draw_mesh()

if robot and robot.client and robot.client.is_connected:
    scene = PlanningScene(robot)
    if attached:
        robot.attach_tool(tool)
        scene.add_attached_tool()
    else:
        if robot.attached_tool:
            scene.remove_attached_tool()
            scene.remove_collision_mesh('attached_tool_link_collision_0')
            robot.detach_tool()
# ---------- end attach_tool ----------

# ----
# Static objects
mesh = Mesh(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)
python_2 = GhPythonScript(robot=robot, meshes=mesh)  # inputs meshes: list
# ---------- python_2: Python ----------
import os
from compas.geometry import Frame
from compas.datastructures import Mesh
from compas_fab.robots import PlanningScene
from compas_fab.robots import CollisionMesh
from compas_ghpython.artists import MeshArtist
from compas_rhino.geometry import RhinoMesh

if robot and robot.client and robot.client.is_connected:
    static_cm_name = 'static_objects'
    scene = PlanningScene(robot)
    scene.remove_collision_mesh(static_cm_name)
    if meshes:
        for mesh in meshes:
            mesh = RhinoMesh.from_guid(mesh).to_compas()
            cm = CollisionMesh(mesh, static_cm_name)
            scene.append_collision_mesh(cm)
# ---------- end python_2 ----------

# ----
# Place
crv = Curve(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)
divide = DivideCurve(Curve=crv, Count=20, Kinks=False)  # -> Points, Tangents, Parameters
t0cf = T0CF(tcf_frame=divide.Points, z_offset=z_offset)

# ----
# Pick
pt = Point(Point(-0.06432690563, 0.6685124513, 0.08173572512))
t0cf_2 = T0CF(tcf_frame=pt, z_offset=z_offset)

# ----
# Cartesian pickup plan
pickup_frames = GhPythonScript(pick_t0cf_frame=t0cf_2, approach_offset=approach_offset)  # -> pickup_t0cf_frames
# ---------- pickup_frames: Python ----------
from compas.geometry import Translation
from compas_fab.ghpython.components import coerce_frame

f = coerce_frame(pick_t0cf_frame)
approach_frame = f.copy()
approach_frame.transform(Translation.from_vector([0, 0, approach_offset]))

pickup_t0cf_frames = [approach_frame, f, approach_frame]
# ---------- end pickup_frames ----------
# SOLUTION
plan_cartesian_motion = PlanCartesianMotion(robot=robot, planes=pickup_frames, start_configuration=home_config, compute=Button())  # -> trajectory; inputs planes: list, attached_collision_meshes: list, path_constraints: list, compute: Boolean
#   port planes: The planes or frames through which the path is defined.
#   port start_configuration: The robot's full configuration, i.e. values for all configurable joints of the entire robot, at the starting position. Defaults to the all-zero configuration.
#   port group: The planning group used for calculation. Defaults to the robot's main planning group.
#   port attached_collision_meshes: A list of attached collision meshes to be included for planning.
#   port path_constraints: Optional constraints that can be imposed along the solution path. Note that path calculation won't work if the start_configuration violates these constraints. Defaults to None.
#   port max_step: The approximate distance between the calculated points. (Defined in the robot's units.) Defaults to 0.01.
#   port compute: If True, calculates a trajectory.
#   port trajectory: The calculated trajectory.
# ---------- plan_cartesian_motion: Python ----------
"""
Calculate a cartesian motion path (linear in tool space).

COMPAS FAB v0.19.1
"""
from ghpythonlib.componentbase import executingcomponent as component
from scriptcontext import sticky as st

from compas_fab.ghpython.components import coerce_frame
from compas_fab.ghpython.components import create_id


class PlanCartesianMotion(component):
    def RunScript(self, robot, planes, start_configuration, group, attached_collision_meshes, path_constraints, max_step, compute):

        key = create_id(self, 'trajectory')

        max_step = float(max_step) if max_step else 0.01
        path_constraints = list(path_constraints) if path_constraints else None
        attached_collision_meshes = list(attached_collision_meshes) if attached_collision_meshes else None

        if robot and robot.client and robot.client.is_connected and start_configuration and planes and compute:
            frames = [coerce_frame(plane) for plane in planes]
            st[key] = robot.plan_cartesian_motion(frames,
                                                  start_configuration=start_configuration,
                                                  group=group,
                                                  options=dict(
                                                      max_step=max_step,
                                                      path_constraints=path_constraints,
                                                      attached_collision_meshes=attached_collision_meshes
                                                  ))

        trajectory = st.get(key, None)
        return trajectory
# ---------- end plan_cartesian_motion ----------
trajectory_visualize = TrajectoryVisualize(robot=robot, trajectory=plan_cartesian_motion)  # -> start_configuration, configurations, fraction, time, planes, P, V, A
#   port group: The planning group for which this trajectory was planned.
#   port trajectory: The calculated trajectory.
#   port start_configuration: The start configuration of the trajectory.
#   port configurations: The full configurations along the trajectory.
#   port fraction: Indicates the fraction of requested trajectory that was calculated, e.g. 1 means the full trajectory was found.
#   port time: The time which is needed to execute that trajectory at full speed.
#   port planes: The planes of the robot's end-effector.
#   port P: The positions along the trajectory
#   port V: The velocities along the trajectory
#   port A: The accelerations along the trajectory
# ---------- trajectory_visualize: Python ----------
"""
Visualizes a trajectory.

COMPAS FAB v0.19.1
"""
from compas_ghpython import draw_frame
from compas_ghpython import list_to_ghtree
from ghpythonlib.componentbase import executingcomponent as component


class TrajectoryVisualize(component):
    def RunScript(self, robot, group, trajectory):
        start_configuration = None
        configurations = []
        fraction = 0.
        time = 0.

        planes = []
        positions = []
        velocities = []
        accelerations = []

        if robot and trajectory:
            group = group or robot.main_group_name

            for c in trajectory.points:
                configurations.append(robot.merge_group_with_full_configuration(c, trajectory.start_configuration, group))
                frame = robot.forward_kinematics(c, group, options=dict(solver='model'))
                planes.append(draw_frame(frame))
                positions.append(c.positions)
                velocities.append(c.velocities)
                accelerations.append(c.accelerations)

            start_configuration = trajectory.start_configuration
            fraction = trajectory.fraction
            time = trajectory.time_from_start

        P = list_to_ghtree(list(zip(*positions)))
        V = list_to_ghtree(list(zip(*velocities)))
        A = list_to_ghtree(list(zip(*accelerations)))

        # return outputs if you have them; here I try it for you:
        return (start_configuration, configurations, fraction, time, planes, P, V, A)
# ---------- end trajectory_visualize ----------

# ----
# Placement plan
number_slider_3 = Slider(0, range=0..100)
prepare_scene = GhPythonScript(robot=robot, i=number_slider_3, place_t0cf_frames=t0cf, element=python.brick, approach_offset=approach_offset)  # -> approach_t0cf_frame, place_t0cf_frame; inputs i: Int32, place_t0cf_frames: list
# ---------- prepare_scene: Python ----------
import math
from compas.geometry import Frame
from compas.geometry import Transformation
from compas.geometry import Translation
from compas_fab.robots import PlanningScene
from compas_fab.robots import AttachedCollisionMesh
from compas_fab.robots import CollisionMesh
from compas_fab.ghpython.components import coerce_frame


place_tolerance = 0.002
place_t0cf_frames = [coerce_frame(f) for f in place_t0cf_frames]
place_t0cf_frame = place_t0cf_frames[i]
place_t0cf_frame = place_t0cf_frame.transformed(Translation.from_vector([0, 0, 0.006 + place_tolerance]))
approach_t0cf_frame = place_t0cf_frame.transformed(Translation.from_vector([0, 0, approach_offset]))

if robot and robot.client.is_connected:
    built_elements = 'built_elements'
    scene = PlanningScene(robot)
    scene.remove_collision_mesh(built_elements)

    for f in robot.from_t0cf_to_tcf(place_t0cf_frames[0:i]):
        t = Transformation.from_frame(f)
        mesh = element.transformed(t)
        cm = CollisionMesh(mesh, built_elements)
        scene.append_collision_mesh(cm)

    scene.remove_attached_collision_mesh('brick')
    scene.remove_collision_mesh('brick')
    ee_link_name = robot.get_end_effector_link_name()
    if robot.attached_tool:
        brick_frame = robot.attached_tool.frame.copy()
    else:
        brick_frame = Frame.worldXY()

    # Centered origin, get half
    brick_frame.point.x += 0.006
    brick_acm = AttachedCollisionMesh(CollisionMesh(element, 'brick', brick_frame), ee_link_name)
    scene.add_attached_collision_mesh(brick_acm)
# ---------- end prepare_scene ----------
plan_trajectory = GhPythonScript(
    robot=robot,
    home_config=home_config,
    pickup_trajectory=plan_cartesian_motion,
    approach_t0cf_frame=prepare_scene.approach_t0cf_frame,
    place_t0cf_frame=prepare_scene.place_t0cf_frame,
    compute=Button())  # -> trajectory, place_trajectory
# ---------- plan_trajectory: Python ----------
import math
from compas.geometry import Frame
from compas.geometry import Transformation
from compas.geometry import Translation
from compas_ghpython.artists import MeshArtist
from compas.robots import Configuration
from compas_fab.robots import PlanningScene
from compas_fab.robots import AttachedCollisionMesh
from compas_fab.robots import CollisionMesh
from compas_fab.ghpython.components import coerce_frame
from scriptcontext import sticky as st

key = '{}_{}'.format('trajectory', ghenv.Component.InstanceGuid)
place_key = '{}_{}'.format('place_trajectory', ghenv.Component.InstanceGuid)

place_t0cf_frame = coerce_frame(place_t0cf_frame)
approach_t0cf_frame = coerce_frame(approach_t0cf_frame)


if robot and robot.client.is_connected and compute:
    start_configuration = robot.zero_configuration()
    if pickup_trajectory:
        start_configuration.joint_values = pickup_trajectory.points[-1].joint_values

    tolerance_position = 0.001
    tolerance_axes = [math.radians(1)] * 3

    # create goal constraints from frame
    goal_constraints = robot.constraints_from_frame(approach_t0cf_frame,
                                                    tolerance_position,
                                                    tolerance_axes,
                                                    group)

    trajectory = robot.plan_motion(goal_constraints,
                                   start_configuration,
                                   group,
                                   options=dict(planner_id='RRTstarkConfigDefault'))

    frames = []
    frames.append(approach_t0cf_frame)
    frames.append(place_t0cf_frame)

    start_configuration = robot.zero_configuration()
    start_configuration.joint_values = trajectory.points[-1].joint_values

    place_trajectory = robot.plan_cartesian_motion(frames,
                                                   start_configuration,
                                                   group=group,
                                                   options=dict(
                                                       max_step=0.01,
                                                       avoid_collisions=True,
                                                   ))

    if place_trajectory and place_trajectory.fraction < 1.0:
        raise Exception('Incomplete trajectory. Fraction={}'.format(place_trajectory.fraction))

#    scene.remove_attached_collision_mesh('brick')
#    scene.remove_collision_mesh('brick')

    st[key] = trajectory
    st[place_key] = place_trajectory

trajectory = st.get(key)
place_trajectory = st.get(place_key)
# ---------- end plan_trajectory ----------
move_trajectory = TrajectoryVisualize(robot=robot, trajectory=plan_trajectory.trajectory)  # -> start_configuration, configurations, fraction, time, planes, P, V, A; same code as trajectory_visualize
place_trajectory = TrajectoryVisualize(robot=robot, trajectory=plan_trajectory.place_trajectory)  # -> start_configuration, configurations, fraction, time, planes, P, V, A; same code as trajectory_visualize
merge_trajectories = GhPythonScript(pick=plan_cartesian_motion, move=plan_trajectory.trajectory, place=plan_trajectory.place_trajectory)  # -> configurations
# ---------- merge_trajectories: Python ----------
configurations = pick.points + move.points + place.points + list(reversed(place.points)) + list(reversed(move.points))
# ---------- end merge_trajectories ----------

ik = InverseKinematics(robot=robot, plane=prepare_scene.approach_t0cf_frame)  # -> configuration
#   port plane: The plane or frame to calculate the inverse kinematic for.
#   port start_configuration: If passed, calculates the inverse such that the joint positions differ the least from the start_configuration. Defaults to the zero configuration.
#   port group: The planning group used for calculation. Defaults to the robot's main planning group.
#   port configuration: The planning group's configuration.
# ---------- ik: Python ----------
"""
Calculate the robot's inverse kinematic for a given plane.

COMPAS FAB v0.19.1
"""
from ghpythonlib.componentbase import executingcomponent as component

from compas_fab.ghpython.components import coerce_frame


class InverseKinematics(component):
    def RunScript(self, robot, plane, start_configuration, group):
        configuration = None
        if robot and robot.client and robot.client.is_connected and plane:
            frame = coerce_frame(plane)
            configuration = robot.inverse_kinematics(frame, start_configuration, group)
        return configuration
# ---------- end ik ----------
ik_2 = InverseKinematics(robot=robot, plane=prepare_scene.place_t0cf_frame, start_configuration=ik)  # -> configuration; same code as ik

# ----
# Save to JSON
button = Button()
save = GhPythonScript(i=number_slider_3, trajectory=merge_trajectories, save=button)  # -> out, a; inputs i: Int32, trajectory: list
# ---------- save: Python ----------
import os
import compas

HERE = os.path.dirname(ghenv.Component.OnPingDocument().FilePath)
rfile = os.path.join(HERE, 'results.json')

# We will store a dictionary, each key is the index of the brick (as a string)
results = {}

if save:
    if os.path.exists(rfile):
        results = compas.json_load(rfile)

    if trajectory:
        results[str(i)] = trajectory
        compas.json_dump(results, rfile, pretty=True)
# ---------- end save ----------

# ----
# Visualization
list = ValueList({"Home config": 0, "Cartesian pickup": 1, "Move trajectory": 2, "Cartesian place": 3, "Merged trajectory": 4, "Approach frame": 5, "Place frame": 6}, selected="Home config")
select = StreamFilter(
    Gate=list,
    Stream0=home_config,
    Stream1=trajectory_visualize.configurations,
    Stream2=move_trajectory.configurations,
    Stream3=place_trajectory.configurations,
    Stream4=merge_trajectories,
    Stream5=ik,
    Stream6=ik_2)
reload = BooleanToggle(True)

item = ListItem(List=select, Index=Slider(0, range=0..200), Wrap=True)

# ----
# OUTPUT
visualize = GhPythonScript(robot=robot, configuration=item, reload_scene=reload)  # -> visual, frames, attached_collision_meshes, collision_meshes
# ---------- visualize: Python ----------
import Grasshopper
import System
from ghpythonlib.componentbase import executingcomponent as component
from scriptcontext import sticky as st

from compas.geometry import Frame
from compas.geometry import Transformation
from compas_ghpython.artists import MeshArtist
from compas_ghpython import draw_frame
from compas_fab.ghpython.components import create_id

class RobotVisualize(component):
    def SetUpParam(self, p, name, nickname, description):
        p.Name = name
        p.NickName = nickname
        p.Description = description
        p.Optional = True

    def RegisterInputParams(self, pManager):
        p = Grasshopper.Kernel.Parameters.Param_GenericObject()
        self.SetUpParam(p, "robot", "robot", "The robot.")
        p.Access = Grasshopper.Kernel.GH_ParamAccess.item
        self.Params.Input.Add(p)

        p = Grasshopper.Kernel.Parameters.Param_String()
        self.SetUpParam(p, "group", "group", "The planning group used for end-effector and base visualization.")
        p.Access = Grasshopper.Kernel.GH_ParamAccess.item
        self.Params.Input.Add(p)

        p = Grasshopper.Kernel.Parameters.Param_GenericObject()
        self.SetUpParam(p, "configuration", "configuration", "The robot's full configuration.")
        p.Access = Grasshopper.Kernel.GH_ParamAccess.item
        self.Params.Input.Add(p)

        p = Grasshopper.Kernel.Parameters.Param_Boolean()
        self.SetUpParam(p, "reload_scene", "reload_scene", "Whether or not to reload the scene information from the client.")
        p.Access = Grasshopper.Kernel.GH_ParamAccess.item
        self.Params.Input.Add(p)

    def RegisterOutputParams(self, pManager):

        p = Grasshopper.Kernel.Parameters.Param_GenericObject()
        self.SetUpParam(p, "visual", "visual", "The robot's visual meshes.")
        self.Params.Output.Add(p)

        p = Grasshopper.Kernel.Parameters.Param_GenericObject()
        self.SetUpParam(p, "frames", "frames", "The robot's joint frames.")
        self.Params.Output.Add(p)

        p = Grasshopper.Kernel.Parameters.Param_GenericObject()
        self.SetUpParam(p, "attached_collision_meshes", "attached_collision_meshes", "Attached collision meshes in the scene.")
        self.Params.Output.Add(p)

        p = Grasshopper.Kernel.Parameters.Param_GenericObject()
        self.SetUpParam(p, "collision_meshes", "collision_meshes", "Collision meshes in the scene.")
        self.Params.Output.Add(p)

    def SolveInstance(self, DA):
        p0 = self.marshal.GetInput(DA, 0)
        p1 = self.marshal.GetInput(DA, 1)
        p2 = self.marshal.GetInput(DA, 2)
        p3 = self.marshal.GetInput(DA, 3)
        result = self.RunScript(p0, p1, p2, p3)

        if result is not None:
            if not hasattr(result, '__getitem__'):
                self.marshal.SetOutput(result, DA, 0, True)
            else:
                self.marshal.SetOutput(result[0], DA, 0, True)
                self.marshal.SetOutput(result[1], DA, 1, True)
                self.marshal.SetOutput(result[2], DA, 2, True)
                self.marshal.SetOutput(result[3], DA, 3, True)

    def RunScript(self, robot, group, configuration, reload_scene):

        visual = None
        frames = None
        collision_meshes = []
        attached_collision_meshes = []

        if robot:
            configuration = configuration or robot.zero_configuration()

            robot.update(configuration, visual=True, collision=False)
            frames = [draw_frame(f) for f in robot.transformed_frames(configuration, group)]

            visual = robot.artist.draw_visual()

        scene_key = create_id(self, 'scene')

        if robot and (reload_scene or scene_key not in st):
            st[scene_key] = robot.client.get_planning_scene()

        scene = st.get(scene_key, None)

        if scene and robot and robot.client and robot.client.is_connected:

            scene_key_co = scene_key + '_co'
            if reload_scene or scene_key_co not in st:
                for co in scene.world.collision_objects:
                    header = co.header
                    frame_id = header.frame_id
                    cms = co.to_collision_meshes()

                    for cm in cms:
#                        if frame_id != '/world':
#                            raise NotImplementedException('Only world-referenced collision meshes are supported')

                        if cm.frame != Frame.worldXY():
                            t = Transformation.from_frame(cm.frame)
                            mesh = cm.mesh.transformed(t)
                        else:
                            mesh = cm.mesh

                        rhino_mesh = MeshArtist(mesh).draw_mesh()
                        collision_meshes.append(rhino_mesh)
                st[scene_key_co] = collision_meshes

            collision_meshes = st.get(scene_key_co, None)

            for aco in scene.robot_state.attached_collision_objects:
                # Noetic compat fix
                if 'pose' in aco.object:
                    del aco.object['pose']
                for acm in aco.to_attached_collision_meshes():
                    frame_id = aco.object['header']['frame_id']
                    frame = robot.forward_kinematics(configuration, options=dict(link=frame_id))
                    t = Transformation.from_frame(frame)

                    # Local CM frame
                    if acm.collision_mesh.frame and acm.collision_mesh.frame != Frame.worldXY():
                        t = t * Transformation.from_frame(acm.collision_mesh.frame)

                    mesh = acm.collision_mesh.mesh.transformed(t)

                    rhino_mesh = MeshArtist(mesh).draw_mesh()
                    attached_collision_meshes.append(rhino_mesh)

        return (visual, frames, attached_collision_meshes, collision_meshes)
# ---------- end visualize ----------

# ==== cluster T0CF
tcf_frame = ClusterInput()
z_offset = ClusterInput()
pln = Plane(tcf_frame)
num = Number(z_offset)

# ----
# Adjust to UR5 frame
xz = XZPlane(Origin=pln)
prot = RotatePlane(Plane=xz, Angle=-1.57)

vec = VectorXYZ(XComponent=0, YComponent=0, ZComponent=num)  # -> Vector, Length
move = Move(Geometry=prot, Motion=vec.Vector)  # -> Geometry, Transform
pln_2 = Plane(move.Geometry)
t0cf_frame = ClusterOutput(pln_2)
