# Grasshopper definition 799_pick_and_place_with_rrc.ghx (Grasshopper 1.0.7)

connect = BooleanToggle(True)
load_robot = BooleanToggle(True)
ros = ROSConnect(connect=connect)  # -> ros_client, is_connected; inputs port: Int32, connect: Boolean
#   port ip: The ip address ROS. Defaults to 127.0.0.1.
#   port port: The port of ROS. Defaults to 9090.
#   port connect: If True, connects to ROS. If False, disconnects from ROS. Defaults to False.
#   port ros_client: The ROS client.
#   port is_connected: True if connection established.
# ---------- ros: Python ----------
"""
Connect or disconnect to ROS.

COMPAS FAB v0.19.1
"""
from ghpythonlib.componentbase import executingcomponent as component
from scriptcontext import sticky as st

from compas_fab.backends import RosClient
from compas_fab.ghpython.components import create_id


class ROSConnect(component):
    def RunScript(self, ip, port, connect):
        ros_client = None

        ip = ip or '127.0.0.1'
        port = port or 9090

        key = create_id(self, 'ros_client')
        ros_client = st.get(key, None)

        if ros_client:
            st[key].close()
        if connect:
            st[key] = RosClient(ip, port)
            st[key].run(5)

        ros_client = st.get(key, None)
        is_connected = ros_client.is_connected if ros_client else False
        return (ros_client, is_connected)
# ---------- end ros ----------
robot = ROSRobot(ros_client=ros.ros_client, load=load_robot)  # -> robot; inputs load: Boolean
#   port ros_client: The ROS client.
#   port load: If True, loads the robot from ROS. Defaults to False.
# ---------- robot: Python ----------
"""
Load robot directly from ROS.

COMPAS FAB v0.19.1
"""
from compas_ghpython.artists import RobotModelArtist
from ghpythonlib.componentbase import executingcomponent as component
from scriptcontext import sticky as st

from compas_fab.ghpython.components import create_id


class ROSRobot(component):
    def RunScript(self, ros_client, load):
        key = create_id(self, 'robot')

        if ros_client and ros_client.is_connected and load:
            # Load URDF from ROS
            st[key] = ros_client.load_robot(load_geometry=True, precision='12f')
            st[key].artist = RobotModelArtist(st[key].model)

        robot = st.get(key, None)
        if robot:  # client sometimes need to be restarted, without needing to reload geometry
            robot.client = ros_client
        return robot
# ---------- end robot ----------

# ---- group: set config
# Configuration
a2 = Slider(0, range=-360..360)
a4 = Slider(0, range=-360..360)
a5 = Slider(0, range=-360..360)
a1 = Slider(0, range=-360..360)
a3 = Slider(0, range=-360..360)
a6 = Slider(0, range=-360..360)
config = PythonScript(vals=[a1, a2, a3, a4, a5, a6])  # -> config; inputs vals: list
# ---------- config: Python ----------
import math
from compas.robots import Configuration

config = Configuration.from_revolute_values([math.radians(a) for a in vals])
# ---------- end config ----------

# ----
robot_2 = Data(robot)
scene = PlanningScene(robot=robot_2)  # -> scene
#   port scene: A planning scene.
# ---------- scene: Python ----------
"""
Create a planning scene.

COMPAS FAB v0.21.1
"""
from ghpythonlib.componentbase import executingcomponent as component
from scriptcontext import sticky as st

from compas_fab.ghpython.components import create_id
from compas_fab.robots import PlanningScene


class PlanningSceneComponent(component):
    def RunScript(self, robot):
        key = create_id(self, 'planning_scene')
        if robot:
            st[key] = PlanningScene(robot)
        return st.get(key, None)
# ---------- end scene ----------
mesh = Mesh(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)
cm = CollisionMesh(scene=scene, mesh=mesh, identifier="table", add=Button(), remove=Button())  # -> ok; inputs mesh: Mesh, add: Boolean, remove: Boolean
#   port scene: The planning scene.
#   port mesh: A collision mesh.
#   port identifier: The identifier of the collision mesh.
#   port add: If True, adds the collision mesh to the planning scene.
#   port remove: If True, removes the collision mesh from the planning scene.
#   port ok: True if the operation was successfully performed.
# ---------- cm: Python ----------
"""
Add or remove a collision mesh from the planning scene.

COMPAS FAB v0.21.1
"""
from compas_rhino.geometry import RhinoMesh
from ghpythonlib.componentbase import executingcomponent as component

from compas_fab.robots import CollisionMesh


class CollisionMeshComponent(component):
    def RunScript(self, scene, M, name, add, remove):
        ok = False
        if scene and M and name:
            mesh = RhinoMesh.from_geometry(M).to_compas()
            collision_mesh = CollisionMesh(mesh, name)
            if add:
                scene.add_collision_mesh(collision_mesh)
                ok = True
            if remove:
                scene.remove_collision_mesh(name)
                ok = True
        return ok
# ---------- end cm ----------
list = ValueList({"Home": 0, "IK": 1, "Cartesian pick": 2, "Free-space move": 3, "Cartesian place": 4, "Merged": 5}, selected="Merged")
refresh = Button()

# ----
# Cartesian pick
pt = Point(Point(1.077060657, 0.3413145346, 0.921979437))
pt_2 = Point(Point(0.7840134875, 0.3413145346, 0.2637407401))

xy = XYPlane(Origin=pt)
xy_2 = XYPlane(Origin=pt_2)
pflip = FlipPlane(Plane=xy, ReverseX=False, ReverseY=False, SwapAxes=True)
pflip_2 = FlipPlane(Plane=xy_2, ReverseX=False, ReverseY=False, SwapAxes=True)

ik = InverseKinematics(robot=robot_2, plane=pflip)  # -> configuration
#   port plane: The plane or frame to calculate the inverse kinematic for.
#   port start_configuration: If passed, calculates the inverse such that the joint positions differ the least from the start_configuration. Defaults to the zero configuration.
#   port group: The planning group used for calculation. Defaults to the robot's main planning group.
#   port configuration: The planning group's configuration.
# ---------- ik: Python ----------
"""
Calculate the robot's inverse kinematic for a given plane.

COMPAS FAB v0.21.1
"""
from ghpythonlib.componentbase import executingcomponent as component

from compas_fab.ghpython.components import coerce_frame


class InverseKinematics(component):
    def RunScript(self, robot, plane, start_configuration, group):
        configuration = None
        if robot and robot.client and robot.client.is_connected and plane:
            frame = coerce_frame(plane)
            configuration = robot.inverse_kinematics(frame, start_configuration, group)
        return configuration
# ---------- end ik ----------
plan_cartesian_motion = PlanCartesianMotion(robot=robot_2, planes=[pflip, pflip_2], start_configuration=ik, compute=Button())  # -> trajectory; inputs planes: list, attached_collision_meshes: list, path_constraints: list, compute: Boolean
#   port planes: The planes or frames through which the path is defined.
#   port start_configuration: The robot's full configuration, i.e. values for all configurable joints of the entire robot, at the starting position. Defaults to the all-zero configuration.
#   port group: The planning group used for calculation. Defaults to the robot's main planning group.
#   port attached_collision_meshes: A list of attached collision meshes to be included for planning.
#   port path_constraints: Optional constraints that can be imposed along the solution path. Note that path calculation won't work if the start_configuration violates these constraints. Defaults to None.
#   port max_step: The approximate distance between the calculated points. (Defined in the robot's units.) Defaults to 0.01.
#   port compute: If True, calculates a trajectory.
#   port trajectory: The calculated trajectory.
# ---------- plan_cartesian_motion: Python ----------
"""
Calculate a cartesian motion path (linear in tool space).

COMPAS FAB v0.21.1
"""
from ghpythonlib.componentbase import executingcomponent as component
from scriptcontext import sticky as st

from compas_fab.ghpython.components import coerce_frame
from compas_fab.ghpython.components import create_id


class PlanCartesianMotion(component):
    def RunScript(self, robot, planes, start_configuration, group, attached_collision_meshes, path_constraints, max_step, compute):

        key = create_id(self, 'trajectory')

        max_step = float(max_step) if max_step else 0.01
        path_constraints = list(path_constraints) if path_constraints else None
        attached_collision_meshes = list(attached_collision_meshes) if attached_collision_meshes else None

        if robot and robot.client and robot.client.is_connected and start_configuration and planes and compute:
            frames = [coerce_frame(plane) for plane in planes]
            st[key] = robot.plan_cartesian_motion(frames,
                                                  start_configuration=start_configuration,
                                                  group=group,
                                                  options=dict(
                                                      max_step=max_step,
                                                      path_constraints=path_constraints,
                                                      attached_collision_meshes=attached_collision_meshes
                                                  ))

        trajectory = st.get(key, None)
        return trajectory
# ---------- end plan_cartesian_motion ----------
trajectory_visualize = TrajectoryVisualize(robot=robot_2, trajectory=plan_cartesian_motion)  # -> start_configuration, configurations, fraction, time, planes, P, V, A
#   port group: The planning group for which this trajectory was planned.
#   port trajectory: The calculated trajectory.
#   port start_configuration: The start configuration of the trajectory.
#   port configurations: The full configurations along the trajectory.
#   port fraction: Indicates the fraction of requested trajectory that was calculated, e.g. 1 means the full trajectory was found.
#   port time: The time which is needed to execute that trajectory at full speed.
#   port planes: The planes of the robot's end-effector.
#   port P: The positions along the trajectory
#   port V: The velocities along the trajectory
#   port A: The accelerations along the trajectory
# ---------- trajectory_visualize: Python ----------
"""
Visualizes a trajectory.

COMPAS FAB v0.21.1
"""
from compas_ghpython import draw_frame
from compas_ghpython import list_to_ghtree
from ghpythonlib.componentbase import executingcomponent as component


class TrajectoryVisualize(component):
    def RunScript(self, robot, group, trajectory):
        start_configuration = None
        configurations = []
        fraction = 0.
        time = 0.

        planes = []
        positions = []
        velocities = []
        accelerations = []

        if robot and trajectory:
            group = group or robot.main_group_name

            for c in trajectory.points:
                configurations.append(robot.merge_group_with_full_configuration(c, trajectory.start_configuration, group))
                frame = robot.forward_kinematics(c, group, options=dict(solver='model'))
                planes.append(draw_frame(frame))
                positions.append(c.positions)
                velocities.append(c.velocities)
                accelerations.append(c.accelerations)

            start_configuration = trajectory.start_configuration
            fraction = trajectory.fraction
            time = trajectory.time_from_start

        P = list_to_ghtree(list(zip(*positions)))
        V = list_to_ghtree(list(zip(*velocities)))
        A = list_to_ghtree(list(zip(*accelerations)))

        # return outputs if you have them; here I try it for you:
        return (start_configuration, configurations, fraction, time, planes, P, V, A)
# ---------- end trajectory_visualize ----------
item = ListItem(List=trajectory_visualize.configurations, Index=Slider(50, range=0..100), Wrap=True)

# ----
# Free-space move
get_start = GhPythonScript(trajectory=plan_cartesian_motion)  # -> config
# ---------- get_start: Python ----------
from compas.robots import Configuration

config = trajectory.points[0]
# ---------- end get_start ----------

# ----
# Cartesian place
pt_3 = Point(Point(-0.3353907995, 0.6994652856, 0.5804205952))
pt_4 = Point(Point(-0.3353907995, 0.6994652856, 0.3392212155))

xy_3 = XYPlane(Origin=pt_3)
xy_4 = XYPlane(Origin=pt_4)
pflip_3 = FlipPlane(Plane=xy_3, ReverseX=False, ReverseY=False, SwapAxes=True)
pflip_4 = FlipPlane(Plane=xy_4, ReverseX=False, ReverseY=False, SwapAxes=True)

ik_2 = InverseKinematics(robot=robot_2, plane=pflip_3)  # -> configuration; same code as ik
plan_cartesian_motion_2 = PlanCartesianMotion(robot=robot_2, planes=pflip_4, start_configuration=ik_2, compute=Button())  # -> trajectory; inputs planes: list, attached_collision_meshes: list, path_constraints: list, compute: Boolean; same code as plan_cartesian_motion
trajectory_visualize_2 = TrajectoryVisualize(robot=robot_2, trajectory=plan_cartesian_motion_2)  # -> start_configuration, configurations, fraction, time, planes, P, V, A; same code as trajectory_visualize
item_2 = ListItem(List=trajectory_visualize_2.configurations, Index=Slider(0, range=0..100), Wrap=True)

constraints_from_plane = ConstraintsFromPlane(robot=robot_2, plane=pflip_3)  # -> constraints
#   port plane: The plane or frame from which we create position and orientation constraints.
#   port group: The planning group for which we specify the constraint. Defaults to the robot's main planning group.
#   port tolerance_position: The allowed tolerance to the frame's position (defined in the robot's units). Defaults to 0.001
#   port tolerance_xaxis: The allowed tolerance of the frame's X-axis in degrees.
#   port tolerance_yaxis: The allowed tolerance of the frame's Y-axis in degrees.
#   port tolerance_zaxis: The allowed tolerance of the frame's Z-axis in degrees.
#   port constraints: A list containing a position and an orientation constraint.
# ---------- constraints_from_plane: Python ----------
"""
Create a position and an orientation constraint from a plane calculated for the group's end-effector link.

COMPAS FAB v0.21.1
"""
import math

from ghpythonlib.componentbase import executingcomponent as component

from compas_fab.ghpython.components import coerce_frame


class ConstraintsFromPlane(component):
    def RunScript(self, robot, plane, group, tolerance_position, tolerance_xaxis, tolerance_yaxis, tolerance_zaxis):
        goal_constraints = None
        if robot and plane:
            tolerance_position = tolerance_position or 0.001
            tolerance_xaxis = tolerance_xaxis or 1.
            tolerance_yaxis = tolerance_yaxis or 1.
            tolerance_zaxis = tolerance_zaxis or 1.

            frame = coerce_frame(plane)
            tolerances_axes = [math.radians(tolerance_xaxis), math.radians(tolerance_yaxis), math.radians(tolerance_zaxis)]
            goal_constraints = robot.constraints_from_frame(frame, tolerance_position, tolerances_axes, group)

        return goal_constraints
# ---------- end constraints_from_plane ----------
plan_motion = PlanMotion(robot=robot_2, goal_constraints=constraints_from_plane, start_configuration=get_start, compute=Button())  # -> trajectory; inputs goal_constraints: list, attached_collision_meshes: list, path_constraints: list, compute: Boolean
#   port goal_constraints: The goal to be achieved, defined in a set of constraints. Constraints can be very specific, for example defining value domains for each joint, such that the goal configuration is included, or defining a volume in space, to which a specific robot link (e.g. the end-effector) is required to move to.
#   port start_configuration: The robot's full configuration, i.e. values for all configurable joints of the entire robot, at the starting position. Defaults to the all-zero configuration.
#   port group: The planning group used for calculation. Defaults to the robot's main planning group.
#   port attached_collision_meshes: A list of attached collision meshes to be included for planning.
#   port path_constraints: Optional constraints that can be imposed along the solution path. Note that path calculation won't work if the start_configuration violates these constraints. Defaults to None.
#   port planner_id: The name of the algorithm used for path planning. Defaults to 'RRTConnectkConfigDefault'
#   port compute: If True, calculates a trajectory.
#   port trajectory: The calculated trajectory.
# ---------- plan_motion: Python ----------
"""
Calculate a motion path.

COMPAS FAB v0.21.1
"""
from ghpythonlib.componentbase import executingcomponent as component
from scriptcontext import sticky as st

from compas_fab.ghpython.components import create_id


class PlanMotion(component):
    def RunScript(self, robot, goal_constraints, start_configuration, group, attached_collision_meshes, path_constraints, planner_id, compute):

        key = create_id(self, 'trajectory')

        path_constraints = list(path_constraints) if path_constraints else None
        attached_collision_meshes = list(attached_collision_meshes) if attached_collision_meshes else None
        planner_id = str(planner_id) if planner_id else 'RRTConnectkConfigDefault'

        if robot and robot.client and robot.client.is_connected and start_configuration and goal_constraints and compute:
            st[key] = robot.plan_motion(goal_constraints,
                                        start_configuration=start_configuration,
                                        group=group,
                                        options=dict(
                                            attached_collision_meshes=attached_collision_meshes,
                                            path_constraints=path_constraints,
                                            planner_id=planner_id,
                                        ))

        trajectory = st.get(key, None)
        return trajectory
# ---------- end plan_motion ----------
trajectory_visualize_3 = TrajectoryVisualize(robot=robot_2, trajectory=plan_motion)  # -> start_configuration, configurations, fraction, time, planes, P, V, A; same code as trajectory_visualize
item_3 = ListItem(List=trajectory_visualize_3.configurations, Index=Slider(0, range=0..100), Wrap=True)

abbclient = GhPythonScript(ros=ros.ros_client)  # -> abb
# ---------- abbclient: Python ----------
import compas_rrc as rrc

abb = rrc.AbbClient(ros)
# ---------- end abbclient ----------
merge = GhPythonScript(pick=plan_cartesian_motion, move=plan_motion, place=plan_cartesian_motion_2)  # -> merged_configs
# ---------- merge: Python ----------
merged_configs = pick.points + list(reversed(pick.points))
merged_configs += move.points
merged_configs += place.points + list(reversed(place.points))
# ---------- end merge ----------
move_trj = GhPythonScript(abb=abbclient, trajectory=merge, move=Button())  # inputs trajectory: list
# ---------- move_trj: Python ----------
import math
import compas_rrc as rrc

if move:
    for cfg in trajectory:
        joint_deg = [math.degrees(j) for j in cfg.joint_values]
        abb.send(rrc.MoveToJoints(joint_deg, [], 500, rrc.Zone.FINE))
# ---------- end move_trj ----------
move_config = GhPythonScript(abb=abbclient, home=ik, move=Button())
# ---------- move_config: Python ----------
import math
import compas_rrc as rrc

joint_deg = [math.degrees(j) for j in home.joint_values]
print joint_deg
#joint_deg = [0,0,0,0,0,0]
if move:
    abb.send(rrc.MoveToJoints(joint_deg, [], 500, rrc.Zone.FINE))
# ---------- end move_config ----------

# ----
# Merge
merge_2 = GhPythonScript(
    pick=trajectory_visualize.configurations,
    move=trajectory_visualize_3.configurations,
    place=trajectory_visualize_2.configurations)  # -> out, merged_configs; inputs pick: list, move: list, place: list
# ---------- merge_2: Python ----------
merged_configs = pick + list(reversed(pick))
merged_configs += move
merged_configs += place + list(reversed(place))
# ---------- end merge_2 ----------
item_4 = ListItem(List=merge_2.merged_configs, Index=Slider(0, range=0..300), Wrap=True)

filter = StreamFilter(Gate=list, Stream0=config, Stream1=ik, Stream2=item, Stream3=item_3, Stream4=item_2, Stream5=item_4)
visualize = GhPythonScript(robot=robot_2, configuration=filter, reload_scene=refresh)  # -> visual, frames, attached_collision_meshes, collision_meshes
# ---------- visualize: Python ----------
import Grasshopper
import System
from ghpythonlib.componentbase import executingcomponent as component
from scriptcontext import sticky as st

from compas.geometry import Frame
from compas.geometry import Transformation
from compas_ghpython.artists import MeshArtist
from compas_ghpython import draw_frame
from compas_fab.ghpython.components import create_id

class RobotVisualize(component):
    def SetUpParam(self, p, name, nickname, description):
        p.Name = name
        p.NickName = nickname
        p.Description = description
        p.Optional = True

    def RegisterInputParams(self, pManager):
        p = Grasshopper.Kernel.Parameters.Param_GenericObject()
        self.SetUpParam(p, "robot", "robot", "The robot.")
        p.Access = Grasshopper.Kernel.GH_ParamAccess.item
        self.Params.Input.Add(p)

        p = Grasshopper.Kernel.Parameters.Param_String()
        self.SetUpParam(p, "group", "group", "The planning group used for end-effector and base visualization.")
        p.Access = Grasshopper.Kernel.GH_ParamAccess.item
        self.Params.Input.Add(p)

        p = Grasshopper.Kernel.Parameters.Param_GenericObject()
        self.SetUpParam(p, "configuration", "configuration", "The robot's full configuration.")
        p.Access = Grasshopper.Kernel.GH_ParamAccess.item
        self.Params.Input.Add(p)

        p = Grasshopper.Kernel.Parameters.Param_Boolean()
        self.SetUpParam(p, "reload_scene", "reload_scene", "Whether or not to reload the scene information from the client.")
        p.Access = Grasshopper.Kernel.GH_ParamAccess.item
        self.Params.Input.Add(p)

    def RegisterOutputParams(self, pManager):

        p = Grasshopper.Kernel.Parameters.Param_GenericObject()
        self.SetUpParam(p, "visual", "visual", "The robot's visual meshes.")
        self.Params.Output.Add(p)

        p = Grasshopper.Kernel.Parameters.Param_GenericObject()
        self.SetUpParam(p, "frames", "frames", "The robot's joint frames.")
        self.Params.Output.Add(p)

        p = Grasshopper.Kernel.Parameters.Param_GenericObject()
        self.SetUpParam(p, "attached_collision_meshes", "attached_collision_meshes", "Attached collision meshes in the scene.")
        self.Params.Output.Add(p)

        p = Grasshopper.Kernel.Parameters.Param_GenericObject()
        self.SetUpParam(p, "collision_meshes", "collision_meshes", "Collision meshes in the scene.")
        self.Params.Output.Add(p)

    def SolveInstance(self, DA):
        p0 = self.marshal.GetInput(DA, 0)
        p1 = self.marshal.GetInput(DA, 1)
        p2 = self.marshal.GetInput(DA, 2)
        p3 = self.marshal.GetInput(DA, 3)
        result = self.RunScript(p0, p1, p2, p3)

        if result is not None:
            if not hasattr(result, '__getitem__'):
                self.marshal.SetOutput(result, DA, 0, True)
            else:
                self.marshal.SetOutput(result[0], DA, 0, True)
                self.marshal.SetOutput(result[1], DA, 1, True)
                self.marshal.SetOutput(result[2], DA, 2, True)
                self.marshal.SetOutput(result[3], DA, 3, True)

    def RunScript(self, robot, group, configuration, reload_scene):

        visual = None
        frames = None
        collision_meshes = []
        attached_collision_meshes = []

        if robot:
            configuration = configuration or robot.zero_configuration()

            robot.update(configuration, visual=True, collision=False)
            frames = [draw_frame(f) for f in robot.transformed_frames(configuration, group)]

            visual = robot.artist.draw_visual()

        scene_key = create_id(self, 'scene')

        if robot and (reload_scene or scene_key not in st):
            st[scene_key] = robot.client.get_planning_scene()

        scene = st.get(scene_key, None)

        if scene and robot and robot.client and robot.client.is_connected:

            scene_key_co = scene_key + '_co'
            if reload_scene or scene_key_co not in st:
                for co in scene.world.collision_objects:
                    header = co.header
                    frame_id = header.frame_id
                    cms = co.to_collision_meshes()

                    for cm in cms:
                        # if frame_id != '/world':
                        #     raise NotImplementedException('Only world-referenced collision meshes are supported')

                        if cm.frame != Frame.worldXY():
                            t = Transformation.from_frame(cm.frame)
                            mesh = cm.mesh.transformed(t)
                        else:
                            mesh = cm.mesh

                        rhino_mesh = MeshArtist(mesh).draw_mesh()
                        collision_meshes.append(rhino_mesh)
                st[scene_key_co] = collision_meshes

            collision_meshes = st.get(scene_key_co, None)

            for aco in scene.robot_state.attached_collision_objects:
                # Noetic compat fix
                if 'pose' in aco.object:
                    del aco.object['pose']
                for acm in aco.to_attached_collision_meshes():
                    frame_id = aco.object['header']['frame_id']
                    frame = robot.forward_kinematics(configuration, options=dict(link=frame_id))
                    t = Transformation.from_frame(frame)

                    # Local CM frame
                    if acm.collision_mesh.frame and acm.collision_mesh.frame != Frame.worldXY():
                        t = t * Transformation.from_frame(acm.collision_mesh.frame)

                    mesh = acm.collision_mesh.mesh.transformed(t)

                    rhino_mesh = MeshArtist(mesh).draw_mesh()
                    attached_collision_meshes.append(rhino_mesh)

        return (visual, frames, attached_collision_meshes, collision_meshes)
# ---------- end visualize ----------
