# Grasshopper definition XXX_example_reachability.ghx (Grasshopper 1.0.7)

reload = Button()
py = GhPythonScript()  # -> folder
# ---------- py: Python ----------
import os

filepath = ghenv.Component.OnPingDocument().FilePath
folder = os.path.dirname(filepath)
# ---------- end py ----------

# ----
# Robot
load = Button()
python = GhPythonScript(load=load)  # -> robot
# ---------- python: Python ----------
from scriptcontext import sticky as st

import compas

compas.PRECISION = '12f'

from compas_fab.robots.ur5 import Robot
from compas.artists import Artist


# Store robot in component-based key
robot_key = 'robot_{}'.format(str(ghenv.Component.InstanceGuid))

if robot_key not in st:
    st[robot_key] = None
    

if load:
    ur5 = Robot(load_geometry=True)
    ur5.artist = Artist(ur5.model)
    st[robot_key] = ur5

robot = st[robot_key]
# ---------- end python ----------
robot = Data(python)

# ----
# Tool
brep = Brep([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])
rotax = RotateAxis(Geometry=brep, Angle=1.570796327, Axis=Line((0, 0, 0), (0, 0.9573123013, 0)))  # -> Geometry, Transform
z_offset = Slider(0.078, range=-0.1..0.2)
attach = BooleanToggle(True)
mesh = MeshBrep(
    Brep=rotax.Geometry,
    Settings={GridMaxCount=0, GridMinCount=16, JaggedSeams=False, MaxEdgeLength=0, MinEdgeLength=0.0001, MinTolerance=0, Refine=True, RefineAngle=0, RelativeTolerance=0.65, SimplePlanes=True, Tolerance=0})
mjoin = MeshJoin(Meshes=mesh)
attach_tool = GhPythonScript(robot=robot, mesh=mjoin, attached=attach, z_offset=z_offset, name="light_pen")  # -> tool, data
# ---------- attach_tool: Python ----------
import os
from compas_rhino import unload_modules
from compas.geometry import Frame
from compas.datastructures import Mesh
from compas_fab.robots import PlanningScene
from compas_fab.robots import Tool
from compas_ghpython.artists import MeshArtist

from compas_rhino.geometry import RhinoMesh

# create tool from mesh and frame
mesh = RhinoMesh.from_geometry(mesh).to_compas()

#mesh.to_obj(r"C:\Users\rustr\workspace\teaching\workshop_sjsu\src\workshop_sjsu\data\tool.obj")
frame = Frame([z_offset, 0, 0], [0, 0, -1], [0, 1, 0])
tool = Tool(mesh, frame, name=name)

data = [tool.data]

if robot:
    if attached:
        robot.attach_tool(tool)
    else:
        if robot.attached_tool:
            robot.detach_tool()
# ---------- end attach_tool ----------

# ----
# Sphere
pt = Point(Point(0.4071428571, 0, 0.2266666667))
sph = Sphere(Base=pt, Radius=Slider(0.15, range=0..1))

py_2 = PythonScript(reload=reload)
# ---------- py_2: Python ----------
if reload:
    from compas_ghpython import unload_modules
    unload_modules('compas')
    unload_modules('workshop_sjsu')
    unload_modules('compas_fab')
# ---------- end py_2 ----------
xz = XZPlane(Origin=pt)
num = Number(1.570796327)

# ----
# 3. Load results
panel = Panel("XXX_example_reachability_out.json")
py_3 = GhPythonScript(folder=py, filename=panel)  # -> filepath
# ---------- py_3: Python ----------
import os


filepath = os.path.join(folder, filename)
# ---------- end py_3 ----------
from_json = FromJSON(json=py_3)  # -> result
#   port json: JSON file path or JSON string.
#   port result: Deserialized objects.
# ---------- from_json: Python ----------
"""
Deserializes JSON into COMPAS objects.
"""
from ghpythonlib.componentbase import executingcomponent as component

import compas


class CompasInfo(component):
    def RunScript(self, json):
        try:
            return compas.json_load(json)
        except:    # noqa: E722
            return compas.json_loads(json)
# ---------- end from_json ----------
frame = Frame(frame=from_json)  # -> plane
#   port frame: The frame or plane to be drawn.
#   port plane: The drawn plane.
# ---------- frame: Python ----------
"""
Draws a frame or plane.
"""
from ghpythonlib.componentbase import executingcomponent as component

from compas_ghpython.artists import FrameArtist
from compas_ghpython.components import coerce_frame


class CompasFrame(component):
    def RunScript(self, frame):
        plane = None

        if frame:
            frame = coerce_frame(frame)
            artist = FrameArtist(frame)

            plane = artist.draw()

        return plane
# ---------- end frame ----------
pt_2 = Point(frame)
preview = CustomPreview(Geometry=pt_2, Material=ColourSwatch(SwatchColor=RGB(255, 255, 255)))

# ----
# 1. Define points on sphere
# 2. Run "XXX_example_reachability.py"
number_slider = Slider(0.014, range=0..0.1)
python_2 = GhPythonScript(sphere=sph, step=Slider(2, range=0..10), length=number_slider)  # -> points, planes; inputs sphere: Surface, step: Int32
# ---------- python_2: Python ----------
import math
import Rhino.Geometry as rg

print sphere.Domain(0)

curves = []
for angle in range(0, 180, step):
    crv = sphere.IsoCurve(0, math.radians(angle))
    curves.append(crv)


points = []
for crv in curves:
    ok, circle = crv.TryGetCircle()
    umfang = 2 * math.pi * circle.Radius
    count = int(round(umfang/length))
    params = rg.Curve.DivideByCount(crv, count, True)
    if params:
        points += [crv.PointAt(p) for p in params]



ok, sphere = sphere.TryGetSphere()
planes = []
for point in points:
    dir = sphere.Center - point
    planes.append(rg.Plane(point, dir))
# ---------- end python_2 ----------
pt_3 = Point(python_2.points)
py_4 = GhPythonScript(plane=python_2.planes)  # -> frame
# ---------- py_4: Python ----------
from compas.geometry import Frame

frame = Frame(plane.Origin, plane.XAxis, plane.YAxis)
#frame = robot.from_tcf_to_t0cf([frame])[0]
# ---------- end py_4 ----------
py_5 = GhPythonScript(folder=py, filename="XXX_example_reachability_in.json")  # -> filepath; same code as py_3
to_json = ToJSON(data=py_4, filepath=py_5)  # -> json; inputs data: list, pretty: Boolean
#   port data: COMPAS data objects to serialize.
#   port filepath: File path where to store the JSON file. If empty, it will not store to disk but instead return the JSON string.
#   port pretty: If True, JSON data will be formatted with indentation and key sorting.
#   port json: JSON file path or JSON string.
# ---------- to_json: Python ----------
"""
Serializes COMPAS objects to JSON.
"""
from ghpythonlib.componentbase import executingcomponent as component

import compas


class CompasInfo(component):
    def RunScript(self, data, filepath, pretty):
        json = filepath

        if filepath:
            compas.json_dump(data, filepath, pretty)
        else:
            json = compas.json_dumps(data, pretty)

        return json
# ---------- end to_json ----------

py_6 = GhPythonScript(folder=py, filename="XXX_example_reachability_tool.json")  # -> filepath; same code as py_3
to_json_2 = ToJSON(data=attach_tool.data, filepath=py_6, pretty=Toggle(False))  # -> json; inputs pretty: Boolean; same code as to_json

# ---- group: set config
# Configuration
number_slider_2 = Slider(342, range=0..500)
item = ListItem(List=python_2.planes, Index=number_slider_2, Wrap=True)
python_3 = GhPythonScript(robot=robot, plane=item)  # -> configurations
# ---------- python_3: Python ----------
from compas.geometry import Frame
from compas.robots import Configuration
from compas_fab.backends.kinematics.solvers import UR5Kinematics

if plane:
    
    f = Frame(plane.Origin, plane.XAxis, plane.YAxis)
    ft0 = robot.from_tcf_to_t0cf([f])[0]
    
    configurations = []
    for jv in UR5Kinematics().inverse(ft0):
        configurations.append(Configuration.from_revolute_values(jv))
# ---------- end python_3 ----------
item_2 = ListItem(List=python_3, Index=Slider(2, range=0..7), Wrap=True)

# ----
robot_visualize = RobotVisualize(robot=robot, configuration=item_2)  # -> visual, collision, attached_meshes, frames, base_frame, ee_frame; inputs attached_collision_meshes: list, show_visual: Boolean, show_collision: Boolean, show_frames: Boolean, show_base_frame: Boolean, show_end_effector_frame: Boolean, show_acm: Boolean
#   port group: The planning group used for end-effector and base visualization.
#   port configuration: The robot's full configuration.
#   port attached_collision_meshes: A list of attached collision meshes.
#   port show_visual: Whether or not to show the robot's visual meshes.
#   port show_collision: Whether or not to show the robot's collision meshes.
#   port show_frames: Whether or not to show the robot's joint frames.
#   port show_base_frame: Whether or not to show the robot's base frame.
#   port show_end_effector_frame: Whether or not to show the robot's end-effector frame.
#   port show_acm: Whether or not to show the attached collision meshes (if any).
#   port visual: The robot's visual Rhino meshes (if any).
#   port collision: The robot's collision Rhino meshes (if any).
#   port attached_meshes: The attached collision Rhino meshes (if any).
#   port frames: The robot's joint frames as Rhino planes (if any).
#   port base_frame: The robot's base frame as a Rhino plane (if any).
#   port ee_frame: The robot's end-effector frame as a Rhino plane (if any).
# ---------- robot_visualize: Python ----------
"""
Visualizes the robot.

COMPAS FAB v0.19.1
"""
from compas.geometry import Frame
from compas.geometry import Transformation
from compas_ghpython.artists import FrameArtist
from compas_ghpython.artists import MeshArtist
from ghpythonlib.componentbase import executingcomponent as component


class RobotVisualize(component):
    def RunScript(self, robot, group, configuration, attached_collision_meshes, show_visual, show_collision,
                  show_frames, show_base_frame, show_end_effector_frame, show_acm):

        visual = None
        collision = None
        attached_meshes = None
        frames = None
        base_frame = None
        ee_frame = None

        if robot:
            show_visual = True if show_visual is None else show_visual
            configuration = configuration or robot.zero_configuration()

            robot.update(configuration, visual=show_visual, collision=show_collision)
            compas_frames = robot.transformed_frames(configuration, group)

            if show_visual:
                visual = robot.artist.draw_visual()

            if show_collision:
                collision = robot.artist.draw_collision()

            if show_base_frame:
                base_compas_frame = compas_frames[0]
                artist = FrameArtist(base_compas_frame)
                base_frame = artist.draw()

            if show_end_effector_frame:
                ee_compas_frame = robot.forward_kinematics(configuration, group, options=dict(solver='model'))
                artist = FrameArtist(ee_compas_frame)
                ee_frame = artist.draw()

            if show_frames:
                frames = []
                for compas_frame in compas_frames[1:]:
                    artist = FrameArtist(compas_frame)
                    frame = artist.draw()
                    frames.append(frame)

            if show_acm:
                attached_meshes = []
                for acm in attached_collision_meshes:
                    frame = robot.forward_kinematics(configuration, options=dict(solver='model', link_name=acm.link_name))
                    T = Transformation.from_frame_to_frame(Frame.worldXY(), frame)
                    mesh = acm.collision_mesh.mesh.transformed(T)
                    attached_meshes.append(MeshArtist(mesh).draw())

        return (visual, collision, attached_meshes, frames, base_frame, ee_frame)
# ---------- end robot_visualize ----------

# ----
# Camera
_360_camera = Geometry(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)
move = Move(Geometry=_360_camera, Motion=pt)  # -> Geometry, Transform

rotate = Rotate(Geometry=move.Geometry, Angle=num, Plane=xz)  # -> Geometry, Transform
mesh_2 = MeshBrep(
    Brep=rotate.Geometry,
    Settings={GridMaxCount=0, GridMinCount=16, JaggedSeams=False, MaxEdgeLength=0, MinEdgeLength=0.0001, MinTolerance=0, Refine=True, RefineAngle=0, RelativeTolerance=0.65, SimplePlanes=True, Tolerance=0})

preview_2 = CustomPreview(Geometry=rotate.Geometry, Material=ColourSwatch(SwatchColor=RGB(0, 0, 0)))
